# Dynamo graph PostedFromOrkestra.dyn "run" (Dynamo 2.3.0.5885)

code_block = CodeBlock { [0,0,4,4,0,4]; }
code_block_2 = CodeBlock { [0,6,6,4,4,0]; }
byCoordinates = Point.ByCoordinates(x=code_block, y=code_block_2)
byPoints = PolyCurve.ByPoints(points=byCoordinates)
code_block_3 = CodeBlock { [0,0,4,4]; }
code_block_4 = CodeBlock { [6,0,0,6]; }
byCoordinates_2 = Point.ByCoordinates(x=code_block_3, y=code_block_4)
code_block_5 = CodeBlock { 6; 12; 18; 24; 30; }
translate = Geometry.Translate(geometry=byCoordinates_2, xTranslation=code_block_5.out0)
byPoints_2 = PolyCurve.ByPoints(points=translate)
code_block_6 = CodeBlock { [0,0,4,4]; }
code_block_7 = CodeBlock { [0,6,0,6]; }
byCoordinates_3 = Point.ByCoordinates(x=code_block_6, y=code_block_7)
translate_2 = Geometry.Translate(geometry=byCoordinates_3, xTranslation=code_block_5.out1)
byPoints_3 = PolyCurve.ByPoints(points=translate_2)
list_create = List.Create(item0=byPoints, item1=byPoints_2, item2=byPoints_3)
flatten = List.Flatten(list=list_create)
curves = PolyCurve.Curves(polyCurve=flatten)
code_block_8 = CodeBlock { 5; }
code_block_9 = CodeBlock { "Levels"; }
categorie_s_by_enu_name_s = Custom[Categorie(s) by ENU Name(s)](CategoryNameInEnglish=code_block_9)
all_elements_of_category = ElementsOfCategory(Category=categorie_s_by_enu_name_s.Categorie_s)
code_block_10 = CodeBlock(x=all_elements_of_category) { x[0]; }
wall_types = WallTypes("Curtain Wall")
byCurveAndHeight = Wall.ByCurveAndHeight(curve=curves, height=code_block_8, level=code_block_10, wallType=wall_types)
